# Grasshopper definition AutoPanel.gh (Grasshopper 1.0.7)
# plug-ins: Human

B = Geometry(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)

# ---- group: H
geo = Geometry(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)

# ----
list = ValueList({"Lenght": 0, "Divisions": 1}, selected="Lenght")
gate = StreamGate(Stream=B, Gate=list)  # -> Target0, Target1
gate_2 = StreamGate(Stream=geo, Gate=list)  # -> Target0, Target1
divlength = DivideLength(Curve=gate.Target0, Length=expr("x*0.001", Slider(3000, range=0..3000)))  # -> Points, Tangents, Parameters
divlength_2 = DivideLength(Curve=gate_2.Target0, Length=expr("x*0.001", Slider(950, range=0..1000)))  # -> Points, Tangents, Parameters
panel = Panel(divlength_2.Points)
end = EndPoints(Curve=gate.Target0)  # -> Start, End
lng = ListLength(List=divlength.Points)
ins = InsertItems(List=divlength.Points, Item=end.End, Indices=lng, Wrap=True)
end_2 = EndPoints(Curve=gate_2.Target0)  # -> Start, End
item = ListItem(List=divlength_2.Points, Index="0", Wrap=True)
cull_i = CullIndex(List=divlength_2.Points, Indices="0", Wrap=True)

# ---- group: point couples
python = GhPythonScript(x=divlength.Points)  # -> a; inputs x: list of Point3d; disabled
# ---------- python: Python ----------
__author__ = "riccardo"
__version__ = "2023.02.14"

import rhinoscriptsyntax as rs
# for accesssing GH classes
import clr
clr.AddReference("Grasshopper")
from Grasshopper.Kernel.Data import GH_Path
from Grasshopper import DataTree

geometryTree = DataTree[object]()
list = []

for i in range(len(x)-1):
    path = GH_Path(i)
    
    
    b = [x[i], x[i+1]]
    geometryTree.AddRange(b, path)

a = geometryTree
# ---------- end python ----------
python_2 = GhPythonScript(x=python)  # -> a; inputs x: list; disabled
# ---------- python_2: Python ----------
__author__ = "riccardo"
__version__ = "2023.02.14"

a = x
# ---------- end python_2 ----------

# ----
lng_2 = ListLength(List=cull_i)
ins_2 = InsertItems(List=cull_i, Item=end_2.End, Indices=lng_2, Wrap=True)
pt = Point(python_2)  # disabled
vec2pt = Vector2Pt(PointA=item, PointB=ins_2, Unitize=False)  # -> Vector, Length
crossref = CrossReference(ListA=ins, ListB=vec2pt.Vector, CrossMode=1)  # -> ListA, ListB
move = Move(Geometry=crossref.ListA, Motion=crossref.ListB)  # -> Geometry, Transform
ins_3 = InsertItems(List=move.Geometry, Item=ins, Indices=0, Wrap=True)
lng_3 = ListLength(List=ins)
layertable = LayerTable(Update=True, AutoUpdate=True)  # -> Layers, FullLayerPaths, LayerColors, Linetypes, MaterialNames, Visible, PrintWidth, PrintColor
c_script = CSharpScript(x=ins_3, y=lng_3)  # -> A; inputs x: list of Point3d, y: Int32
# ---------- c_script: C# ----------
    int k = x.Count - y - 1;

    for (int i = 0;i < k; i++)
    {
      int a = i + 1;
      if (a % y != 0)
      {
        GH_Path path = new GH_Path();

        List<Point3d> pList = new List<Point3d>() {
            x[i],
            x[i + 1],
            x[i + y + 1],
            x[i + y],
            x[i]
            };

        Polyline pl = new Polyline(pList);

        dt.Add(pl, path);
      }
    }

    A = dt;
# ---------- c_script: C# additional code ----------
  DataTree<Polyline> dt = new DataTree<Polyline>();
# ---------- end c_script ----------
geo_2 = Geometry(c_script)
panel_2 = Panel(layertable.Layers)
c_script_2 = CSharpScript(y=Toggle(True), x=geo_2)  # -> C; inputs y: Boolean, x: list of Polyline
# ---------- c_script_2: C# ----------
    if (y)
    {
      for (int i = 0; i < x.Count; i++)
      {
        Point3d p0 = x[i][0];
        double ba = p0.DistanceTo(x[i][1]);

        Point3d p1 = x[i][1];
        double he = p1.DistanceTo(x[i][2]);

        string item = Math.Round(ba, 0).ToString() + '-' + Math.Round(he, 0).ToString();
        list.Add(item);
      }
    }

    C = list;
# ---------- c_script_2: C# additional code ----------
  List<string> list = new List<string>();
# ---------- end c_script_2 ----------
