# Grasshopper definition AutoPanel2.gh (Grasshopper 1.0.7)
# plug-ins: ScriptParasite, EleFront, MetaHopper, Human, Heteroptera

# Ordine dei Layers da Rhino:
# 
# 'dir'   => PARENT LAYER
# -------------------
# > 'dir-border-h'  => 1 LINEA (BORDO H)
# > 'dir-border-v'  => 1 LINEA (BORDO V)
# 
# > 'dir-h-x.x'     => N LINEE (FUGHE H)
# > ...
# > 'dir-v-x.x'     => N LINEE (FUGHE V)
# > ...
# -------------------
# 
# 'obs'   => PARENT LAYER
# -------------------
# > obs-[...]       => N POLILINEE (OSTACOLI)
# > ...
# -------------------
panel = Panel("""Librerie aggiuntive:
Elefront
Human
MetaHopper""")
panel_2 = Panel("CONTROLLO MANUALE LAYERS")
panel_3 = Panel("""dir-border-h
dir-border-v
dir-h-2.2
dir-h-8.8
dir-v-8.8
dir-b-8.8.5.5""")

panel_4 = Panel("""obs-windows
obs-detach
obs-pavement
obs-other""")
reflay = ReferenceByLayer(LayerName=panel_4)  # -> simplify(Geometry)

reflay_2 = ReferenceByLayer(LayerName=panel_3)
merge = Merge(Data1=graft(panel_3), Data2=reflay_2)  # -> simplify(Result)

# ---- group: GENERATOR
c_script = CSharpScript(x=merge, y=reflay)  # -> pl, layerNames, names, archive, freeTag, A; inputs x: tree, y: tree
# ---------- c_script: C# usings ----------
using Rhino.Geometry.Intersect;
using System.Linq;
using Rhino.FileIO;
using System.Runtime.Remoting.Messaging;
using System.Reflection;
# ---------- c_script: C# ----------
    grid = new Grid(x, y);
    panelC41s = grid.panels;

    pl = grid.Plines(panelC41s);
    layerNames = grid.LayerNameTags(panelC41s);
    names = grid.NameTags(panelC41s);
    archive = Archive(panelC41s);
    freeTag = grid.FreeTag(panelC41s);
# ---------- c_script: C# additional code ----------
  // fields
  public Grid grid;
  public List<PanelC41> panelC41s;

  public List<string> archive;

  public class Grid
  {
    public DataTree<object> param;
    public DataTree<Polyline> obs;

    // tutte le coordinate delle fughe in X e Y
    public List<double> xCoordinates;
    public List<double> yCoordinates;

    public List<PanelC41> panels;
    public List<Point3d> pts;

    public Grid(DataTree<object> x, DataTree<object> y)
    {
      param = x;

      obs = new DataTree<Polyline>();

      for (int i = 0; i < y.BranchCount; i++)
      { obs.AddRange(y.Branch(i).Select(pl => (PolylineCurve)pl).ToList().Select(pl => pl.ToPolyline()).ToList(), new GH_Path(i)); }

      OrderLines(param);

      pts = new List<Point3d>();

      panels = Panels(xCoordinates, yCoordinates);
    }

    public void OrderLines(DataTree<object> param)
    {
      List<double> xtmp = new List<double>();
      List<double> ytmp = new List<double>();

      // param.BranchCount - 1 perch� l'ultimo branch sono i bordi esterni
      for (int i = 2; i < param.BranchCount - 1; i++)
      {
        int fuga = (int)Convert.ToInt64(param.Branch(i)[0].ToString().Split('-')[2].ToString().Split('.')[0]);
        string dir = param.Branch(i)[0].ToString().Split('-')[1];

        List<double> tmp = new List<double>();

        if (dir == "h")
        {
          // start at j = 1 perchè la prima linea è il nome del layer 
          for (int j = 1; j < param.Branch(i).Count; j++)
          {
            PolylineCurve tmpPl = (PolylineCurve)param.Branch(i)[j];
            tmp.Add(tmpPl.PointAt(0).Y - fuga);
            tmp.Add(tmpPl.PointAt(0).Y + fuga);
          }

          ytmp.AddRange(tmp);
        }

        else if (dir == "v")
        {
          // start at j = 1 perchè la prima linea è il nome del layer
          for (int j = 1; j < param.Branch(i).Count; j++)
          {
            PolylineCurve tmpPl = (PolylineCurve)param.Branch(i)[j];
            tmp.Add(tmpPl.PointAt(0).X - fuga);
            tmp.Add(tmpPl.PointAt(0).X + fuga);
          }

          xtmp.AddRange(tmp);
        }
      }

      xtmp.Sort();
      ytmp.Sort();

      xCoordinates = xtmp;
      yCoordinates = ytmp;

      Borders(param);
    }

    public List<PanelC41> Panels(List<double> xCoordinates, List<double> yCoordinates)
    {
      List<PanelC41> panels = new List<PanelC41>();

      for (int i = 0; i < yCoordinates.Count; i += 2)
      {
        for (int j = 0; j < xCoordinates.Count; j += 2)
        {
          var points = new List<Point3d>
            {
              new Point3d(xCoordinates[j], yCoordinates[i], 0),
              new Point3d(xCoordinates[j + 1], yCoordinates[i], 0),
              new Point3d(xCoordinates[j + 1], yCoordinates[i + 1], 0),
              new Point3d(xCoordinates[j], yCoordinates[i + 1], 0),
              new Point3d(xCoordinates[j], yCoordinates[i], 0)
              };

          pts.AddRange(points.GetRange(0, 4));

          PanelC41 tmpPanel = new PanelC41(points, obs);
          if (!tmpPanel.crossed) panels.Add(tmpPanel);
        }
      }

      return panels;
    }

    public List<Polyline> Plines(List<PanelC41> panels)
    {
      List<Polyline> polylines = panels.Select(i => i.pl).ToList();

      return polylines;
    }

    public List<bool> FreeTag(List<PanelC41> panels)
    {
      List<bool> freeTag = panels.Select(i => i.crossed).ToList();

      return freeTag;
    }

    public List<string> LayerNameTags(List<PanelC41> panels)
    {
      List<string> nameTags = panels.Select(i => i.name).ToList();

      return nameTags;
    }

    public List<string> NameTags(List<PanelC41> panels)
    {
      List<string> names = panels.Select(i => i.type).ToList();
      for (int i = 0; i < panels.Count; i++)
      {
        names[i] = names[i] + " - " + panels[i].name;
      }

      return names;
    }

    void Borders(DataTree<object> param)
    {
      int[] fughe = param.Branch(param.BranchCount - 1)[0].ToString().Split('-')[2].Split('.').Select(element => Convert.ToInt32(element)).ToArray();

      PolylineCurve curve = (PolylineCurve)param.Branch(param.BranchCount - 1)[1];

      double[] x = new double[4];
      double[] y = new double[4];

      for (int i = 0; i < 4; i++)
      {
        x[i] = curve.Point(i).X;
        y[i] = curve.Point(i).Y;
      }

      yCoordinates.Insert(0, Math.Round(y.Min() + fughe[0]));
      xCoordinates.Insert(xCoordinates.Count, Math.Round(x.Max() - fughe[1]));
      yCoordinates.Insert(yCoordinates.Count, Math.Round(y.Max() - fughe[2]));
      xCoordinates.Insert(0, Math.Round(x.Min() + fughe[3]));
    }
  }

  public class PanelC41
  {
    //fields
    public double width;
    public double height;
    public double borderUp;
    public double borderDown;
    public double hookUp;
    public double hookDown;

    public Polyline pl;
    public bool crossed;
    public string type;
    public string name;

    //Constructor
    public PanelC41(List<Point3d> list, DataTree<Polyline> obs)
    {
      borderUp = 1;
      borderDown = 2;
      hookUp = 3;
      hookDown = 4;
      type = "A";

      crossed = false;

      pl = new Polyline(list);
      int[] i = Intercept(obs);

      if (i[0] >= 0)
      {
        crossed = InterceptedPanelVertical(obs.Branch(0), i[0], 8);
      }
      if (i[1] >= 0)
      {
        crossed = InterceptedPanelHorizontal(obs.Branch(2), i[1], 8);
      }

      Name();
      Detached(obs.Branch(1));
      InterceptedPanelVarious(obs.Branch(3));
    }

    public void Name()
    {
      width = Math.Round(pl[0].DistanceTo(pl[1]));
      height = Math.Round(pl[1].DistanceTo(pl[2]));
      name = width.ToString() + '-' + height.ToString();
    }

    public int[] Intercept(DataTree<Polyline> obs)
    {
      // ora non funziona per ostacoli multipli che intersecano oggetti

      int counter = 0;
      int b = -1;
      int c = -1;

      for (int i = 0; i < obs.Branch(0).Count; i++)
      {
        var tmp = Intersection.CurveCurve(pl.ToPolylineCurve(), obs.Branch(0)[i].ToPolylineCurve(), 0.1, 0.1).Count;
        counter += tmp;
        if (tmp != 0) b = i;
      }

      for (int i = 0; i < obs.Branch(2).Count; i++)
      {
        var tmp = Intersection.CurveCurve(pl.ToPolylineCurve(), obs.Branch(2)[i].ToPolylineCurve(), 0.1, 0.1).Count;
        counter += tmp;
        if (tmp != 0) c = i;
      }

      if (counter == 0) crossed = false;
      else crossed = true;
      return new int[] { b, c };
    }

    public bool InterceptedPanelVertical(List<Polyline> obs, int i, double fuga)
    {
      // Funziona solo per finestre centrate sui pannelli
      // Viene considerata solo la Y quindi

      double[] yObs = new double[] { obs[i][0].Y, obs[i][1].Y, obs[i][2].Y };
      double[] y = new double[] { pl[0].Y, pl[1].Y, pl[2].Y };

      if (yObs.Max() >= y.Max() && yObs.Min() <= y.Min())
      {
        return true;
      }
      else if (y.Max() > yObs.Max())
      {
        double newY = yObs.Max();
        List<Point3d> tmp = new List<Point3d>()
        {
          new Point3d(pl[0].X, newY + fuga,0),
          new Point3d(pl[1].X, newY+ fuga,0),
          new Point3d(pl[2]),
          new Point3d(pl[3]),
          new Point3d(pl[4].X, newY+ fuga,0),
        };

        pl = new Polyline(tmp);
        return false;
      }
      else if (y.Min() < yObs.Min())
      {
        double newY = yObs.Min();
        List<Point3d> tmp = new List<Point3d>()
        {
          new Point3d(pl[0]),
          new Point3d(pl[1]),
          new Point3d(pl[2].X, newY - fuga,0),
          new Point3d(pl[3].X, newY - fuga,0),
          new Point3d(pl[4]),
        };

        pl = new Polyline(tmp);

        return false;
      }

      else { return false; }
    }

    public bool InterceptedPanelHorizontal(List<Polyline> obs, int i, double fuga)
    {
      // Funziona solo per rettangoli orizzontali centrati sui pannelli
      // Viene considerata solo la X quindi

      double[] xObs = new double[] { obs[i][0].X, obs[i][1].X, obs[i][2].X };
      double[] x = new double[] { pl[0].X, pl[1].X, pl[2].X };

      if (xObs.Max() >= x.Max() && xObs.Min() <= x.Min())
      {
        return true;
      }

      else if (x.Max() > xObs.Max())
      {
        double newX = xObs.Max();
        List<Point3d> tmp = new List<Point3d>()
        {
          new Point3d(newX + fuga, pl[0].Y, 0),
          new Point3d(pl[1]),
          new Point3d(pl[2]),
          new Point3d(newX + fuga, pl[3].Y,0 ),
          new Point3d(newX + fuga, pl[0].Y, 0)
        };

        pl = new Polyline(tmp);
        return false;
      }

      else if (x.Min() < xObs.Min())
      {
        double newX = xObs.Min();
        List<Point3d> tmp = new List<Point3d>()
        {
          new Point3d(pl[0]),
          new Point3d(newX - fuga, pl[1].Y, 0),
          new Point3d(newX - fuga, pl[2].Y, 0),
          new Point3d(pl[3]),
          new Point3d(pl[0])
        };

        pl = new Polyline(tmp);

        return false;
      }

      else { return false; }
    }

    public void InterceptedPanelVarious(List<Polyline> obs)
    {
      int counter = 0;

      double[] x = new double[] { pl[0].X, pl[1].X };
      double[] y = new double[] { pl[0].Y, pl[1].Y };

      for (int i = 0; i < obs.Count; i++)
      {
        var tmp = Intersection.CurveCurve(pl.ToPolylineCurve(), obs[i].ToPolylineCurve(), 0.1, 0.1).Count;
        counter += tmp;

        double[] xObs = new double[] { obs[i][0].X, obs[i][1].X};
        double[] yObs = new double[] { obs[i][0].Y, obs[i][1].Y};

        if (xObs[1] > x[1] && x[0] > xObs[0] && y[1] > yObs[1] && y[0] > yObs[0]) counter++;
        if (xObs[1] < x[1] && x[0] < xObs[0] && y[1] < yObs[1] && y[0] < yObs[0]) counter++;
      }

      if (counter > 0) type = "C";
    }

    public void Detached(List<Polyline> det)
    {
      // Per ogni Line di intersezione 

      int counter = 0;

      for (int i = 0; i < det.Count; i++)
      {
        var tmp = Intersection.CurveCurve(pl.ToPolylineCurve(), det[i].ToPolylineCurve(), 0.1, 0.1).Count;
        counter += tmp;
      }

      if (counter != 0)
      {
        type = "B";
      }
    }
  }

  public List<string> Archive(List<PanelC41> panelC41s)
  {
    List<string> list;
    var orderedPanels = panelC41s.OrderBy(panelC41 => panelC41.width).ThenBy(panelC41 => panelC41.height);

    list = orderedPanels.Select(x => x.name).ToList();

    List<string> arc = new List<string> { list[0] };
    for (int i = 1; i < list.Count; i++)
    {
      if (list[i] != list[i - 1])
      {
        arc.Add(list[i]);
      }
    }

    return arc;
  }
# ---------- end c_script ----------
scriptpar = ScriptParasite(Enable=True, Folder="C:\Users\riccardo\source\repos\GH_Develop\AutoPanel")

# ---- group: ACTIVATE
toggle = BooleanToggle(False)

# ---- group: VIEW
toggle_2 = BooleanToggle(True)

# ---- group: WIRE DISPLAY
list = ValueList({"def": 0, "fai": 1, "hid": 2}, selected="hid")

# ----
wiredisplay = ControlWireDisplay(WireDisplay=list, AllObjects_Object=[c_script, layers, qb, area, textbaker, python, textbaker_2])
onoff = EnableDisableObject(Enabled=toggle, AllObjects_Object=[layers, qb, textbaker])
hideshow = HideShowObjectPreview(Visible=toggle_2, AllObjects_Object=[preview, textbaker_2])
layers = CreateModifyLayers(LayerName=c_script.archive, DeleteLayer=False, enableFullPath=False)  # -> LayerNames, LayerFullPath; disabled

area = Area(Geometry=c_script.pl)  # -> Area, Centroid
python = GhPythonScript(x=c_script.layerNames)  # -> a
# ---------- python: Python ----------
__author__ = "riccardo"
__version__ = "2023.02.21"

import rhinoscriptsyntax as rs

a = '%' + x
# ---------- end python ----------

panel_5 = Panel("BAKING STATION")
bake = Button()
qb = QuickBaker(Geometric=c_script.pl, Attribute=python, Bake=False)  # disabled

# ---- group: TETX-BAKE
textbaker = TextBaker(
    Location=area.Centroid,
    Text=c_script.names,
    Size="100",
    Attribute=python,
    Justification=4,
    Bake=bake,
    Dot_Text=False,
    Enable_Mask=True,
    On_Screen=False)  # disabled

# ---- group: OBSTACLE COLORS
cluster = Cluster(x=c_script.freeTag)
geo = Geometry(c_script.pl)
preview = CustomPreview(Geometry=geo, Material=cluster)

# ---- group: TEXT-DISPLAY
textbaker_2 = TextBaker(
    Location=area.Centroid,
    Text=c_script.names,
    Size="100",
    Justification=4,
    Bake=False,
    Dot_Text=False,
    Enable_Mask=True,
    On_Screen=False)

# ==== cluster Cluster
x = ClusterInput()
python = GhPythonScript(x=x)  # -> a
# ---------- python: Python ----------
__author__ = "riccardo"
__version__ = "2023.02.21"

import rhinoscriptsyntax as rs

if (x == False):
    a = '63,232,232'
else:
    a = '230,37,232'
# ---------- end python ----------
material = CreateMaterial(Diffuse=python, Specular=RGB(255, 255, 255), Emission=RGB(0, 0, 0), Transparency=0, Shine=0)
M = ClusterOutput(material)
